# Dynamo graph csv_revit_csv.dyn (Dynamo 2.1.0.7500)

views = Views("Спецификация мебели")
string = StringInput("C:\Users\ASUS\Documents\Revit+Dynamo\тест.txt")
byProperties = Revit.Schedules.ScheduleExportOptions.ByProperties()
export = ScheduleView.Export(scheduleView=views, path=string, exportOptions=byProperties)
views_2 = Views("Спецификация мебели")
string_2 = StringInput("C:\Users\ASUS\Documents\Revit+Dynamo\тест.txt")
categories = Categories("OST_Furniture")
all_elements_of_category = ElementsOfCategory(Category=categories)
elementType = Element.ElementType(element=all_elements_of_category)
string_3 = StringInput("C:\Users\ASUS\Documents\Revit+Dynamo\Спецификация мебелиUTF-8.txt")
python_script = Python(IN[0]=string_3)
# ---------- python_script.python (19 lines) ----------
# Загрузить стандартную библиотеку Python и библиотеку DesignScript
import sys
import clr
import csv
import codecs
clr.AddReference('ProtoGeometry')
from Autodesk.DesignScript.Geometry import *

# Введенные в этом узле данные сохраняется в виде списка в переменных IN.
path = IN[0]

# Разместите код под этой строкой
outList = []
f = codecs.open(path, encoding="utf-8") 
data = csv.reader((line.replace('\0','') for line in f), delimiter="\t")
for row in data:
	outList.append(row)
# Назначьте вывод переменной OUT.
OUT = outList
# ----------------------------------------
python_script_2 = Python(IN[0]=elementType, IN[1]=python_script)
# ---------- python_script_2.python (45 lines) ----------
# Загрузить стандартную библиотеку Python и библиотеку DesignScript
import sys
import clr
clr.AddReference('RevitAPI')
from Autodesk.Revit.DB import *
clr.AddReference('RevitAPIUI')
from Autodesk.Revit.UI import *
clr.AddReference('RevitServices')
import RevitServices
from RevitServices.Persistence import DocumentManager
from RevitServices.Transactions import TransactionManager 
clr.AddReference('ProtoGeometry')
from Autodesk.DesignScript.Geometry import *
# Введенные в этом узле данные сохраняется в виде списка в переменных IN.
dataEnteringNode = IN
# Разместите код под этой строкой
elements = IN[0]
list_from_csv = IN[1]
del list_from_csv[0]
parameters = ["HomeLab_Наименование","HomeLab_Производитель", "HomeLab_Артикул", "HomeLab_URL", "HomeLab_Стоимость"]

doc = DocumentManager.Instance.CurrentDBDocument
app = DocumentManager.Instance.CurrentUIApplication.Application
uiapp = DocumentManager.Instance.CurrentUIApplication
app = uiapp.Application
outList = []
for i in UnwrapElement(elements):
  if not (i.LookupParameter("HomeLab_ГМ-ID") is None):
    for csv_obj in list_from_csv:
      if (csv_obj[0] is not None) and (csv_obj[0] == i.LookupParameter("HomeLab_ГМ-ID").AsString()):
        for j in range(len(parameters)-1):
          p = i.LookupParameter(parameters[j])
          TransactionManager.Instance.EnsureInTransaction(doc)
          p.Set(csv_obj[j+2])
          TransactionManager.Instance.TransactionTaskDone()
        p = i.LookupParameter("HomeLab_Стоимость")
        #csv_float = csv_obj[len(csv_obj)-1][1:len(csv_obj[len(csv_obj)-1])-1]
        #outList.append(csv_float)
        TransactionManager.Instance.EnsureInTransaction(doc)
        p.Set(float(csv_obj[len(csv_obj)-1]))
        TransactionManager.Instance.TransactionTaskDone()
      #else:
       # outList.append([(csv_obj[0] is not None), csv_obj[0], i.LookupParameter("HomeLab_ГМ-ID").AsString()])
# Назначьте вывод переменной OUT.
OUT = outList
# ----------------------------------------
python_script_3 = Python(IN[0]=python_script_2)
# ---------- python_script_3.python (13 lines) ----------
# Загрузить стандартную библиотеку Python и библиотеку DesignScript
import sys
import clr
clr.AddReference('ProtoGeometry')
from Autodesk.DesignScript.Geometry import *

# Введенные в этом узле данные сохраняется в виде списка в переменных IN.
dataEnteringNode = IN

# Разместите код под этой строкой

# Назначьте вывод переменной OUT.
OUT = False
# ----------------------------------------
byProperties_2 = Revit.Schedules.ScheduleExportOptions.ByProperties(title=python_script_3)
export_2 = ScheduleView.Export(scheduleView=views_2, path=string_2, exportOptions=byProperties_2)
